% Simulink data dictionary gen_c_code.sldd

y = Simulink.Signal(StorageClass="ExportedGlobal", DataType="single")
z = Simulink.Signal(StorageClass="ExportedGlobal", DataType="single")
x = Simulink.Signal(StorageClass="ImportedExtern", DataType="single")
k = mypkg.Parameter(2, DoubleProperty=0, Int32Property=int32(0), LogicalProperty=false, OnOffCharProperty="off", ColorCharProperty="red", StorageClass="mycsc", DataType="single")